# Grasshopper definition firstGeometry.gh (Grasshopper 1.0.7)
# plug-ins: treesloth01

value_list = ValueList({"One": 1, "Two": 2, "Three": 2² - 1, "Four": Sqrt(16)}, selected="Two")

# ---- group: RH_IN:height
number_slider = Slider(78, range=0..500)

# ---- group: RH_IN:width
number_slider_2 = Slider(33, range=0..500)

# ----
width = GetNumber(number_slider_2, AtLeast=1, AtMost=2147483647, Maximum=1.797693135e+308, Minimum=-1.797693135e+308, TreeAccess=False)
height = GetNumber(number_slider, AtLeast=1, AtMost=2147483647, Maximum=1.797693135e+308, Minimum=-1.797693135e+308, TreeAccess=False)
handlepos = GetNumber(
    value_list,
    AtLeast=1,
    AtMost=1,
    Maximum=1.797693135e+308,
    Minimum=-1.797693135e+308,
    Prompt="handlePos",
    TreeAccess=False)
number_slider_3 = Slider(10, range=0..10)
multiplication = Multiplication(A=width, B=number_slider_3)
multiplication_2 = Multiplication(A=height, B=number_slider_3)
panel = Panel(multiplication)
panel_2 = Panel(multiplication_2)
list_length = ListLength(List=panel_2)
split_list = SplitList(List=handlepos, Index=list_length)  # -> ListA, ListB
data = Data(panel)
rectangle = Rectangle(Plane=PlaneXY(0, 0, 0), XSize=graft(panel), YSize=graft(panel_2), Radius=0)  # -> Rectangle, Length
division = Division(A=panel, B=Slider(2, range=0..10))
list_item = ListItem(List=panel, Index=Slider(0, range=0..100), Wrap=True)
addition = Addition(A=graft(data), B=Slider(100, range=0..100))  # -> flatten(Result)
mass_addition = MassAddition(Input=division)  # -> Result, PartialResults
panel_3 = Panel(split_list.ListA)
merge = Merge(Data1=list_item, Data2=mass_addition.PartialResults)
mass_addition_2 = MassAddition(Input=addition)  # -> Result, PartialResults
panel_4 = Panel(merge)
panel_5 = Panel(addition)
merge_2 = Merge(Data1=Slider(0, range=0..100), Data2=mass_addition_2.PartialResults)  # -> flatten(Result)
first_last = FirstLast()  # -> FirstValue, LastValue
list_length_2 = ListLength(List=merge_2)
subtraction = Subtraction(A=list_length_2, B=Slider(1, range=0..10))
split_list_2 = SplitList(List=merge_2, Index=subtraction)  # -> ListA, ListB
unit_x = UnitX(Factor=split_list_2.ListA)
panel_6 = Panel(split_list_2.ListA)
move = Move(Geometry=graft(rectangle.Rectangle), Motion=graft(unit_x))  # -> Geometry, Transform
move_2 = Move(Geometry=move.Geometry, Motion=Vector(0, 0, 10))  # -> Geometry, Transform
explode = Explode(Curve=move_2.Geometry, Recursive=True)  # -> Segments, Vertices
list_item_2 = ListItem(List=explode.Segments, Index="2", Wrap=True)  # -> Item, Item1, Item2
panel_7 = Panel(list_item_2.Item)
length = Length(Curve=list_item_2.Item)
list_item_3 = ListItem(List=move_2.Geometry, Index=Slider(0, range=0..100), Wrap=True)
subtraction_2 = Subtraction(A=length, B="87.5")
rectangle_2 = Rectangle(Plane=PlaneXY(0, 0, 0), XSize=Slider(120, range=0..1000), YSize=Slider(24, range=0..100), Radius=Slider(3, range=0..10))  # -> Rectangle, Length
evaluate_curve = EvaluateCurve(Curve=reparameterize(list_item_2.Item), Parameter=".5")  # -> Point, Tangent, Angle
evaluate_curve_2 = EvaluateCurve(Curve=list_item_2.Item, Parameter=subtraction_2)  # -> Point, Tangent, Angle
evaluate_curve_3 = EvaluateCurve(Curve=list_item_2.Item, Parameter="87.5")  # -> Point, Tangent, Angle
explode_2 = Explode(Curve=move_2.Geometry, Recursive=True)  # -> Segments, Vertices
base_handle_shape = Data(rectangle_2.Rectangle)
area = Area(Geometry=rectangle_2.Rectangle)  # -> Area, Centroid
area_2 = Area(Geometry=rectangle_2.Rectangle)  # -> Area, Centroid
list_item_4 = ListItem(List=explode_2.Segments, Index="2", Wrap=True)  # -> Item, Item1, Item2
curve = Curve(list_item_4.Item2)
handle_rec_center = Data(area.Centroid)
base_handle_shape_2 = Data(base_handle_shape)
subtraction_3 = Subtraction(A=panel_2, B="48.5")  # -> graft(Result)
length_2 = Length(Curve=curve)
unit_y = UnitY(Factor="48.5")
unit_z = UnitZ(Factor=subtraction_3)
unit_z_2 = UnitZ(Factor=subtraction_3)
unit_z_3 = UnitZ(Factor=subtraction_3)
panel_8 = Panel(subtraction_3)
unit_y_2 = UnitY(Factor=subtraction_3)
panel_9 = Panel("751.5")
evaluate_curve_4 = EvaluateCurve(Curve=reparameterize(list_item_4.Item2), Parameter=".5")  # -> Point, Tangent, Angle
reverse = Reverse(Vector=unit_z)
evaluate_curve_5 = EvaluateCurve(Curve=list_item_4.Item2, Parameter="87.5")  # -> Point, Tangent, Angle
reverse_2 = Reverse(Vector=unit_z_3)
reverse_3 = Reverse(Vector=unit_y)
reverse_4 = Reverse(Vector=unit_z_2)
subtraction_4 = Subtraction(A=length_2, B="87.5")
evaluate_curve_6 = EvaluateCurve(Curve=list_item_4.Item2, Parameter=subtraction_4)  # -> Point, Tangent, Angle
addition_2 = Addition(A=evaluate_curve_3.Point, B=unit_y_2)
addition_3 = Addition(A=evaluate_curve.Point, B=unit_y_2)
addition_4 = Addition(A=evaluate_curve_2.Point, B=unit_y_2)
unit_y_3 = UnitY(Factor="48.5")
addition_5 = Addition(A=evaluate_curve_3.Point, B=reverse_3)
addition_6 = Addition(A=evaluate_curve.Point, B=reverse_3)
addition_7 = Addition(A=evaluate_curve_2.Point, B=reverse_3)
base_handle_shape_3 = Data(base_handle_shape_2)
handle_rec_center_2 = Data(handle_rec_center)
vector_2pt = Vector2Pt(PointA=handle_rec_center_2, PointB=addition_2, Unitize=False)  # -> Vector, Length
vector_2pt_2 = Vector2Pt(PointA=handle_rec_center_2, PointB=addition_3, Unitize=False)  # -> Vector, Length
vector_2pt_3 = Vector2Pt(PointA=handle_rec_center_2, PointB=addition_4, Unitize=False)  # -> Vector, Length
addition_8 = Addition(A=evaluate_curve_5.Point, B=unit_y_3)
addition_9 = Addition(A=evaluate_curve_4.Point, B=unit_y_3)
addition_10 = Addition(A=evaluate_curve_6.Point, B=unit_y_3)
vector_2pt_4 = Vector2Pt(PointA=handle_rec_center_2, PointB=addition_5, Unitize=False)  # -> Vector, Length
vector_2pt_5 = Vector2Pt(PointA=handle_rec_center_2, PointB=addition_6, Unitize=False)  # -> Vector, Length
vector_2pt_6 = Vector2Pt(PointA=handle_rec_center_2, PointB=addition_7, Unitize=False)  # -> Vector, Length
vector_2pt_7 = Vector2Pt(PointA=handle_rec_center_2, PointB=addition_8, Unitize=False)  # -> Vector, Length
vector_2pt_8 = Vector2Pt(PointA=handle_rec_center_2, PointB=addition_9, Unitize=False)  # -> Vector, Length
vector_2pt_9 = Vector2Pt(PointA=handle_rec_center_2, PointB=addition_10, Unitize=False)  # -> Vector, Length
move_3 = Move(Geometry=base_handle_shape_3, Motion=vector_2pt.Vector)  # -> Geometry, Transform
move_4 = Move(Geometry=base_handle_shape_3, Motion=vector_2pt_2.Vector)  # -> Geometry, Transform
move_5 = Move(Geometry=base_handle_shape_3, Motion=vector_2pt_3.Vector)  # -> Geometry, Transform
move_6 = Move(Geometry=base_handle_shape_3, Motion=vector_2pt_4.Vector)  # -> Geometry, Transform
move_7 = Move(Geometry=base_handle_shape_3, Motion=vector_2pt_5.Vector)  # -> Geometry, Transform
move_8 = Move(Geometry=base_handle_shape_3, Motion=vector_2pt_6.Vector)  # -> Geometry, Transform
move_9 = Move(Geometry=base_handle_shape_3, Motion=vector_2pt_8.Vector)  # -> Geometry, Transform
move_10 = Move(Geometry=base_handle_shape_3, Motion=vector_2pt_9.Vector)  # -> Geometry, Transform
move_11 = Move(Geometry=base_handle_shape_3, Motion=vector_2pt_7.Vector)  # -> Geometry, Transform
unit_z_4 = UnitZ(Factor=1)
unit_y_4 = UnitY(Factor=1)
unit_y_5 = UnitY(Factor=1)
area_3 = Area(Geometry=move_6.Geometry)  # -> Area, Centroid
area_4 = Area(Geometry=move_5.Geometry)  # -> Area, Centroid
area_5 = Area(Geometry=move_3.Geometry)  # -> Area, Centroid
area_6 = Area(Geometry=move_11.Geometry)  # -> Area, Centroid
area_7 = Area(Geometry=move_3.Geometry)  # -> Area, Centroid
area_8 = Area(Geometry=move_4.Geometry)  # -> Area, Centroid
area_9 = Area(Geometry=move_9.Geometry)  # -> Area, Centroid
area_10 = Area(Geometry=move_4.Geometry)  # -> Area, Centroid
area_11 = Area(Geometry=move_7.Geometry)  # -> Area, Centroid
area_12 = Area(Geometry=move_6.Geometry)  # -> Area, Centroid
area_13 = Area(Geometry=move_8.Geometry)  # -> Area, Centroid
area_14 = Area(Geometry=move_11.Geometry)  # -> Area, Centroid
area_15 = Area(Geometry=move_7.Geometry)  # -> Area, Centroid
area_16 = Area(Geometry=move_8.Geometry)  # -> Area, Centroid
area_17 = Area(Geometry=move_9.Geometry)  # -> Area, Centroid
area_18 = Area(Geometry=move_10.Geometry)  # -> Area, Centroid
area_19 = Area(Geometry=move_5.Geometry)  # -> Area, Centroid
area_20 = Area(Geometry=move_10.Geometry)  # -> Area, Centroid
orient_direction = OrientDirection(
    Geometry=move_3.Geometry,
    PointA=area_5.Centroid,
    DirectionA=unit_z_4,
    PointB=area_5.Centroid,
    DirectionB=Vector(0, 0, 1))  # -> Geometry, Transform
orient_direction_2 = OrientDirection(
    Geometry=move_4.Geometry,
    PointA=area_8.Centroid,
    DirectionA=unit_z_4,
    PointB=area_8.Centroid,
    DirectionB=Vector(0, 0, 1))  # -> Geometry, Transform
orient_direction_3 = OrientDirection(
    Geometry=move_5.Geometry,
    PointA=area_19.Centroid,
    DirectionA=unit_z_4,
    PointB=area_19.Centroid,
    DirectionB=Vector(0, 0, 1))  # -> Geometry, Transform
orient_direction_4 = OrientDirection(
    Geometry=move_11.Geometry,
    PointA=area_14.Centroid,
    DirectionA=unit_z_4,
    PointB=area_14.Centroid,
    DirectionB=Vector(0, 0, 1))  # -> Geometry, Transform
orient_direction_5 = OrientDirection(
    Geometry=move_9.Geometry,
    PointA=area_17.Centroid,
    DirectionA=unit_z_4,
    PointB=area_17.Centroid,
    DirectionB=Vector(0, 0, 1))  # -> Geometry, Transform
orient_direction_6 = OrientDirection(
    Geometry=move_10.Geometry,
    PointA=area_18.Centroid,
    DirectionA=unit_z_4,
    PointB=area_18.Centroid,
    DirectionB=Vector(0, 0, 1))  # -> Geometry, Transform
orient_direction_7 = OrientDirection(
    Geometry=move_8.Geometry,
    PointA=area_16.Centroid,
    DirectionA=unit_z_4,
    PointB=area_16.Centroid,
    DirectionB=Vector(0, 0, 1))  # -> Geometry, Transform
orient_direction_8 = OrientDirection(
    Geometry=move_6.Geometry,
    PointA=area_12.Centroid,
    DirectionA=unit_z_4,
    PointB=area_12.Centroid,
    DirectionB=Vector(0, 0, 1))  # -> Geometry, Transform
orient_direction_9 = OrientDirection(
    Geometry=move_7.Geometry,
    PointA=area_15.Centroid,
    DirectionA=unit_z_4,
    PointB=area_15.Centroid,
    DirectionB=Vector(0, 0, 1))  # -> Geometry, Transform
panel_10 = Panel("""0
1
2""")
# Curves for Top handle positons:
# TC
# TL
# TR
panel_11 = Panel("""0
1
2
3""")
panel_12 = Panel("""0
1
2""")
weave = Weave(
    Pattern=panel_11,
    Stream0="-",
    Stream1=orient_direction_9.Geometry,
    Stream2=orient_direction_7.Geometry,
    Stream3=orient_direction_8.Geometry,
    NullGaps=False)  # -> simplify(Weave)
# Curves for Bottom handle positons:
# TC
# TL
# TR
weave_2 = Weave(
    Pattern=panel_10,
    Stream0=orient_direction_2.Geometry,
    Stream1=orient_direction_3.Geometry,
    Stream2=orient_direction.Geometry,
    NullGaps=False)  # -> simplify(Weave)
panel_13 = Panel("""0
1
2""")
weave_3 = Weave(
    Pattern=panel_12,
    Stream0=orient_direction_5.Geometry,
    Stream1=orient_direction_4.Geometry,
    Stream2=orient_direction_6.Geometry,
    NullGaps=False)  # -> simplify(Weave)
panel_14 = Panel(orient_direction_8.Geometry)
weave_4 = Weave(Pattern=panel_13, Stream0=weave, Stream1=weave_2, Stream2=weave_3, NullGaps=False)
path_mapper = PathMapper(weave_3, source="{a}", target="{a;2}")
merge_3 = Merge(Data1=weave, Data2=weave_2, Data3=weave_3)
trim_tree = TrimTree(Tree=merge_3, Depth=Slider(1, range=0..10))
list_item_5 = ListItem(List=trim_tree, Index=graft(split_list.ListA), Wrap=True)
panel_15 = Panel(list_item_5)
boundary_surfaces = BoundarySurfaces(Edges=move.Geometry)
panel_16 = Panel(boundary_surfaces)
curve_2 = Curve(list_item_5)
unit_z_5 = UnitZ(Factor=Slider(19, range=0..100))
surface_split = SurfaceSplit(Surface=boundary_surfaces, Curves=list_item_5)
extrude = Extrude(Base=surface_split, Direction=unit_z_5)
list_item_6 = ListItem(List=extrude, Index=Slider(0, range=0..100), Wrap=True)
brep = Brep(list_item_6)
custom_preview = CustomPreview(Geometry=brep, Material=ColourSwatch(SwatchColor=RGB(201, 201, 201)))

# ---- group: RH_OUT:mesh
outputgeo = ContextPrint(Text=brep)
